# Grasshopper definition grasshopper commands (arc).gh (Grasshopper 1.0.7)
# plug-ins: Bifocals

number_slider = Slider(12, range=0..100)
series = Series(Start=Slider(0, range=0..100), Step=Slider(67.5, range=0..100), Count=number_slider)
series_2 = Series(Start=Slider(14, range=0..100), Step=Slider(8.1, range=0..100), Count=expr("x-1", number_slider))
radians = Radians(Degrees=series)
consecutive_domains = ConsecutiveDomains(Numbers=radians, Additive=Toggle(False))
arc = Arc(Plane=PlaneXY(0, 0, 0), Radius=series_2, Angle=consecutive_domains)  # -> Arc, Length
panel = Panel(consecutive_domains)
range = Range(Domain=Domain(0, 1), Steps=expr("x-2", number_slider))
graph_mapper = GraphMapper(
    range,
    x0=0,
    x1=1,
    y0=0,
    y1=1,
    container_name="Bezier",
    cpx=[0, 0.5877066255, 0.5562133789, 1],
    cpy=[0, 0, 0.3135581017, 1])
bounds = Bounds(Numbers=graph_mapper)
construct_domain = ConstructDomain(DomainStart=Slider(25.95, range=0..100), DomainEnd=Slider(100, range=0..100))
remap_numbers = RemapNumbers(Value=graph_mapper, Source=bounds, Target=construct_domain)  # -> Mapped, Clipped
unit_z = UnitZ(Factor=remap_numbers.Mapped)
extrude = Extrude(Base=arc.Arc, Direction=unit_z)
