# Grasshopper definition grasshopper commands (weaver bird).gh (Grasshopper 1.0.7)
# plug-ins: Weaverbird

points = Points([Point(21.42551077, -26.8131128, 0), Point(0.1178551849, -26.10886008, 0), Point(-19.04071554, 0.03812353787, 0), Point(1.92021101, 28.13690393, 0), Point(36.40935848, 25.25906622, 0), Point(46.69545543, -0.2955253222, 0), Point(13.27181478, -14.07903494, 7.903843652), Point(22.74200021, 4.12099658, 5.514701633), Point(4.218486581, 11.31637723, 6.169949893), Point(-9.657433831, -2.70725324, 9.021312242), Point(12.02077009, -1.684377183, 13.5178755), Point(0, 0, 6.62962513), Point(27.73057966, -5.118186711, 5.939681842)])
number_slider = Slider(1.86, range=0..2)
delaunay_mesh = DelaunayMesh(Points=points, Plane=PlaneXY(0, 0, 0))
number_slider_2 = Slider(2, range=0..2)
weaverbird_s_picture_frame = WeaverbirdsPictureFrame(MeshPolylines=delaunay_mesh, Distance=number_slider, InsetType=1)
weaverbird_s_mesh_window = WeaverbirdsMeshWindow(MeshPolylines=delaunay_mesh, Distance=number_slider, InsetType=1)
weaverbird_s_catmull_clark_subdivision = WeaverbirdsCatmullClarkSubdivision(MeshCurves=weaverbird_s_mesh_window, Level=Slider(2.9, range=0..10), SmoothNakedEdges=1)
weaverbird_s_catmull_clark_subdivision_2 = WeaverbirdsCatmullClarkSubdivision(MeshCurves=weaverbird_s_picture_frame, Level=Slider(2.9, range=0..10), SmoothNakedEdges=1)
custom_preview = CustomPreview(Geometry=weaverbird_s_catmull_clark_subdivision, Material=ColourSwatch(SwatchColor=RGB(255, 255, 255)))
custom_preview_2 = CustomPreview(Geometry=weaverbird_s_catmull_clark_subdivision_2, Material=ColourSwatch(SwatchColor=RGB(33, 56, 255)))

points_2 = Points([Point(21.42551077, -26.8131128, 0), Point(0.1178551849, -26.10886008, 0), Point(-19.04071554, 0.03812353787, 0), Point(1.92021101, 28.13690393, 0), Point(36.40935848, 25.25906622, 0), Point(46.69545543, -0.2955253222, 0), Point(13.27181478, -12.46344874, 7.903843652), Point(22.74200021, 4.12099658, 9.551319603), Point(4.218486581, 18.35146835, 6.169949893), Point(-9.657433831, -2.70725324, 14.01308955), Point(12.02077009, -1.684377183, 23.67622128), Point(0, 0, 17.74412918), Point(27.73057966, -5.118186711, 11.75601269)])
number_slider_3 = Slider(3, range=0..10)
delaunay_mesh_2 = DelaunayMesh(Points=points_2, Plane=PlaneXY(0, 0, 0))
weaverbird_s_stellate_cumulation = WeaverbirdsStellateCumulation(MeshPolylines=delaunay_mesh_2, Distance=Slider(2.93, range=0..20))
weaverbird_s_catmull_clark_subdivision_3 = WeaverbirdsCatmullClarkSubdivision(MeshCurves=weaverbird_s_stellate_cumulation, Level=Slider(3, range=0..10), SmoothNakedEdges=1)
weaverbird_s_mesh_thicken = WeaverbirdsMeshThicken(MeshCurves=weaverbird_s_catmull_clark_subdivision_3, Distance=Slider(2, range=0..2), OffsetType=0)
custom_preview_3 = CustomPreview(Geometry=weaverbird_s_mesh_thicken, Material=ColourSwatch(SwatchColor=RGB(33, 56, 255)))
