# Grasshopper definition grasshopper commands (Box morf).gh (Grasshopper 1.0.7)
# plug-ins: Bifocals

unit_z = UnitZ(Factor=Slider(173.66, range=1..500))
curve = Curve(<curve referenced from the Rhino model>)
curve_2 = Curve([<curve referenced from the Rhino model> x2])
unit_z_2 = UnitZ(Factor=Slider(39.55, range=0..100))
extrude = Extrude(Base=curve, Direction=unit_z)
extrude_2 = Extrude(Base=curve_2, Direction=unit_z_2)  # -> graft(Extrusion)
divide_domain² = DivideDomain²(Domain=extrude, UCount=Slider(5, range=0..100), VCount=Slider(10, range=0..100))
geometry = Geometry(<brep referenced from the Rhino model>)
bounding_box = BoundingBox(Content=flatten(geometry), Plane=PlaneXY(0, 0, 0), UnionBox=True)  # -> Box, Box_2
surface_box = SurfaceBox(Surface=extrude, Domain=divide_domain², Height=Slider(10, range=0..10))
box_morph = BoxMorph(Geometry=geometry, Reference=bounding_box.Box, Target=surface_box)
