# Grasshopper definition grasshopper commands (Pipe variable).gh (Grasshopper 1.0.7)
# plug-ins: Bifocals

gene_pool = GenePool(Decimals=3, Maximum=30, Minimum=0, Value=[30, 7.604, 25.045, 8.584, 30])
gene_pool_2 = GenePool(Decimals=3, Maximum=1, Minimum=0, Value=[0, 0.137, 0.5, 0.847, 1])
curve = Curve(reparameterize(<curve referenced from the Rhino model>))
pipe_variable = PipeVariable(Curve=curve, Parameters=gene_pool_2, Radii=gene_pool, Caps=0)
construct_domain² = ConstructDomain²(UMin=Slider(0, range=0..1), UMax=Slider(1, range=0..1), VMin=Slider(0.5, range=0..1), VMax=Slider(0, range=0..1))
isotrim = Isotrim(Surface=reparameterize(pipe_variable), Domain=construct_domain²)
surface = Surface(reparameterize(isotrim))
offset_surface = OffsetSurface(Surface=surface, Distance=Slider(8, range=1..30), Retrim=True)
loft = Loft(
    Curves=[offset_surface, surface],
    Options={Adjust=False, Closed=False, LoftEnds=0, LoftSimp=0, LoftType=0, Rebuild=10, Refit=0.01})
