# Grasshopper definition grasshopper commands (Scale NU).gh (Grasshopper 1.0.7)
# plug-ins: Bifocals

number_slider = Slider(31, range=0..100)
xz_plane = XZPlane(Origin=Point(0, 0, 0))
rectangle = Rectangle(Plane=xz_plane, XSize=number_slider, YSize=number_slider, Radius=0)  # -> Rectangle, Length
number_slider_2 = Slider(19, range=0..100)
md_slider = MDSlider(
    SliderMode=0,
    slider_value=Point(0.8113321444, 0.1862450576, 0.5),
    x_domain=Domain(0, 1),
    y_domain=Domain(0, 1),
    z_domain=Domain(0, 1))
rectangular_array = RectangularArray(Geometry=rectangle.Rectangle, Cell=rectangle.Rectangle, XCount=number_slider_2, YCount=number_slider_2)  # -> Geometry, Transform
area = Area(Geometry=rectangular_array.Geometry)  # -> Area, Centroid
bounding_box = BoundingBox(Content=rectangular_array.Geometry, Plane=PlaneXY(0, 0, 0), UnionBox=True)  # -> Box, Box_2
surface = Surface(rectangular_array.Geometry)
xz_plane_2 = XZPlane(Origin=area.Centroid)
evaluate_surface = EvaluateSurface(Surface=reparameterize(bounding_box.Box), Point=md_slider)  # -> Point, Normal, UDirection, VDirection, Frame
rotate_plane = RotatePlane(Plane=xz_plane_2, Angle=degrees(Slider(45, range=0..100)))
number_slider_3 = Slider(0.5, range=0..1)
closest_point = ClosestPoint(Point=area.Centroid, Cloud=evaluate_surface.Point)  # -> ClosestPoint, CPIndex, Distance
bounds = Bounds(Numbers=closest_point.Distance)
construct_domain = ConstructDomain(DomainStart=Slider(0.2, range=0..1), DomainEnd=1)
line = Line(StartPoint=area.Centroid, EndPoint=closest_point.ClosestPoint)
remap_numbers = RemapNumbers(Value=closest_point.Distance, Source=bounds, Target=construct_domain)  # -> Mapped, Clipped
scale_nu = ScaleNU(Geometry=surface, Plane=rotate_plane, ScaleX=remap_numbers.Mapped, ScaleY=1, ScaleZ=1)  # -> Geometry, Transform
custom_preview = CustomPreview(Geometry=scale_nu.Geometry, Material=ColourSwatch(SwatchColor=RGB(8, 97, 104)))
