# Grasshopper definition grasshopper commands (Tween Curve).gh (Grasshopper 1.0.7)
# plug-ins: Bifocals

number_slider = Slider(20, range=0..20)
number_slider_2 = Slider(2.079, range=0..5)
range = Range(Domain=Domain(0, 1), Steps=number_slider)
curve_a = CurveA(<curve a referenced from the Rhino model>)
curve_b = CurveB(<curve b referenced from the Rhino model>)
negative = Negative(Value=number_slider_2)
tween_curve = TweenCurve(CurveA=curve_a, CurveB=curve_b, Factor=range, BlendType=0)
number = Number([number_slider_2, negative])
repeat_data = RepeatData(Data=number, Length=expr("x+1", number_slider))
unit_z = UnitZ(Factor=repeat_data)
move = Move(Geometry=tween_curve, Motion=unit_z)  # -> Geometry, Transform
loft = Loft(Curves=move.Geometry, Options={Adjust=False, Closed=False, LoftEnds=0, LoftSimp=0, LoftType=0, Rebuild=10, Refit=0.01})
custom_preview = CustomPreview(Geometry=loft, Material=ColourSwatch(SwatchColor=RGB(109, 68, 255)))
