# Grasshopper definition grasshopper commands (arc).gh (Grasshopper 1.0.7)
# plug-ins: Bifocals

number_slider = Slider(12, range=0..100)
series = Series(Start=Slider(0, range=0..100), Step=Slider(67.5, range=0..100), Count=number_slider)
series_2 = Series(Start=Slider(14, range=0..100), Step=Slider(8.1, range=0..100), Count=expr("x-1", number_slider))
radians = Radians(Degrees=series)
consecutive_domains = ConsecutiveDomains(Numbers=radians, Additive=Toggle(False))
arc = Arc(Plane=PlaneXY(0, 0, 0), Radius=series_2, Angle=consecutive_domains)  # -> Arc, Length
list_length = ListLength(List=arc.Arc)
series_3 = Series(Start=Slider(0, range=0..100), Step=Slider(1, range=0..1), Count=list_length)
panel = Panel(consecutive_domains)
range = Range(Domain=Domain(0, 1), Steps=expr("x-2", number_slider))
consecutive_domains_2 = ConsecutiveDomains(Numbers=series_3, Additive=Toggle(False))
deconstruct_domain = DeconstructDomain(Domain=consecutive_domains_2)  # -> Start, End
graph_mapper = GraphMapper(
    range,
    x0=0,
    x1=1,
    y0=0,
    y1=1,
    container_name="Bezier",
    cpx=[0, 0.5877066255, 0.2966791391, 1],
    cpy=[0, 0, 0.6490638852, 1])
bounds = Bounds(Numbers=graph_mapper)
list_item = ListItem(List=arc.Arc, Index=expr("x", deconstruct_domain.End), Wrap=True)
list_item_2 = ListItem(List=arc.Arc, Index=deconstruct_domain.Start, Wrap=True)
construct_domain = ConstructDomain(DomainStart=Slider(25.95, range=0..100), DomainEnd=Slider(100, range=0..100))
remap_numbers = RemapNumbers(Value=graph_mapper, Source=bounds, Target=construct_domain)  # -> Mapped, Clipped
point_on_curve = PointOnCurve(list_item, parameter=0)
point_on_curve_2 = PointOnCurve(list_item_2, parameter=1)
unit_z = UnitZ(Factor=remap_numbers.Mapped)
line = Line(StartPoint=point_on_curve_2, EndPoint=point_on_curve)
join_curves = JoinCurves(Curves=[arc.Arc, line], Preserve=False)
extrude = Extrude(Base=join_curves, Direction=unit_z)
