# Grasshopper definition grasshopper commands (bend).gh (Grasshopper 1.0.7)
# plug-ins: Bifocals

number_slider = Slider(39.43, range=0..100)
number_slider_2 = Slider(40.04, range=0..100)
construct_domain = ConstructDomain(DomainStart=expr("-x/2", number_slider), DomainEnd=expr("x/2", number_slider))
construct_domain_2 = ConstructDomain(DomainStart=expr("-x/2", number_slider_2), DomainEnd=expr("x/2", number_slider_2))
plane_surface = PlaneSurface(Plane=PlaneXY(0, 0, 0), XSize=construct_domain, YSize=construct_domain_2)
unit_z = UnitZ(Factor=Slider(193.55, range=0..200))
extrude = Extrude(Base=plane_surface, Direction=unit_z)
deconstruct_brep = DeconstructBrep(Brep=extrude)  # -> Faces, Edges, Vertices
number_slider_3 = Slider(-74, range=-500..500)
list_item = ListItem(List=deconstruct_brep.Faces, Index=0, Wrap=True)
area = Area(Geometry=list_item)  # -> Area, Centroid
construct_point = ConstructPoint(XCoordinate=number_slider_3, YCoordinate=number_slider_3, ZCoordinate=0)
unit_z_2 = UnitZ(Factor=1)
arc_sed = ArcSED(Start=area.Centroid, End=construct_point, Direction=unit_z_2)  # -> Arc, Plane, Radius
bend_deform = BendDeform(Geometry=extrude, BendingArc=arc_sed.Arc)
