# Grasshopper definition grasshopper commands (box morpf).gh (Grasshopper 1.0.7)
# plug-ins: Bifocals

number_slider = Slider(12, range=0..100)
surface = Surface(reparameterize(<surface referenced from the Rhino model>))
divide_domain² = DivideDomain²(Domain=surface, UCount=number_slider, VCount=number_slider)
md_slider = MDSlider(
    SliderMode=0,
    slider_value=Point(0.7569948522, 0.5564616134, 0.5),
    x_domain=Domain(0, 1),
    y_domain=Domain(0, 1),
    z_domain=Domain(0, 1))
isotrim = Isotrim(Surface=surface, Domain=divide_domain²)
evaluate_surface = EvaluateSurface(Surface=surface, Point=md_slider)  # -> Point, Normal, UDirection, VDirection, Frame
area = Area(Geometry=isotrim)  # -> Area, Centroid
closest_point = ClosestPoint(Point=area.Centroid, Cloud=evaluate_surface.Point)  # -> ClosestPoint, CPIndex, Distance
construct_domain = ConstructDomain(DomainStart=Slider(0, range=0..10), DomainEnd=Slider(1.67, range=0..10))
bounds = Bounds(Numbers=closest_point.Distance)
remap_numbers = RemapNumbers(Value=closest_point.Distance, Source=bounds, Target=construct_domain)  # -> reverse(Mapped), Clipped
surface_box = SurfaceBox(Surface=surface, Domain=divide_domain², Height=remap_numbers.Mapped)
geometry = Geometry(<brep referenced from the Rhino model>)
box = Box(geometry)
box_morph = BoxMorph(Geometry=geometry, Reference=box, Target=surface_box)
