# Grasshopper definition grasshopper commands (brep plane).gh (Grasshopper 1.0.7)
# plug-ins: Bifocals

md_slider = MDSlider(SliderMode=0, slider_value=Point(0, 0, 0.5), x_domain=Domain(0, 1), y_domain=Domain(0, 1), z_domain=Domain(0, 1))
md_slider_2 = MDSlider(
    SliderMode=0,
    slider_value=Point(0.7439200878, 0.8838904321, 0.5),
    x_domain=Domain(0, 1),
    y_domain=Domain(0, 1),
    z_domain=Domain(0, 1))
md_slider_3 = MDSlider(SliderMode=0, slider_value=Point(1, 1, 0.5), x_domain=Domain(0, 1), y_domain=Domain(0, 1), z_domain=Domain(0, 1))

surface = Surface(reparameterize(<surface referenced from the Rhino model>))
curve_on_surface = CurveOnSurface(Surface=surface, UVCoordinates=[md_slider, md_slider_2, md_slider_3], Closed=False)  # -> Curve, Length, Domain
range = Range(Domain=Domain(0, 1), Steps=Slider(41, range=0..100))
graph_mapper = GraphMapper(range, x0=0, x1=1, y0=0, y1=1, container_name="Bezier", cpx=[0, 0.4772727191, 0.7613636255, 1], cpy=[0, 0, 1, 1])
perp_frame = PerpFrame(Curve=reparameterize(curve_on_surface.Curve), Parameter=graph_mapper)
brep_plane = BrepPlane(Brep=surface, Plane=perp_frame)  # -> Curves, Points
