# Grasshopper definition grasshopper commands (contour).gh (Grasshopper 1.0.7)
# plug-ins: Bifocals

unit_y = UnitY(Factor=1)
point = Point(Point(15.62690615, 32.90038029, 0))
brep = Brep(<brep referenced from the Rhino model>)
contour = Contour(Shape=brep, Point=point, Direction=unit_y, Distance=Slider(2, range=0..100))
unit_y_2 = UnitY(Factor=Slider(1, range=0..10))
surface = Surface(contour)
extrude = Extrude(Base=surface, Direction=unit_y_2)
