# Grasshopper definition grasshopper commands (curv, curv ).gh (Grasshopper 1.0.7)
# plug-ins: Bifocals

unit_y = UnitY(Factor=1)
point = Point([Point(-10.90284786, 87.88734967, 0), Point(48.24885424, 70.06637524, 0), Point(142.1544263, 72.16608487, 0), Point(200.645632, 87.55072746, 0), Point(257.2041811, 93.39353604, 0)])
point_2 = Point([Point(-15.79754633, 11.10386693, 0), Point(52.58240146, 23.02733698, 0), Point(136.2039513, 3.227438618, 0), Point(194.4128911, 18.88705545, 0), Point(256.5445296, 5.225822214, 0)])
line_sdl = LineSDL(Start=Point(0, 0, 0), Direction=unit_y, Length=Slider(100, range=0..100))
unit_x = UnitX(Factor=Slider(5, range=1..50))
polyline = PolyLine(Vertices=point, Closed=False)
polyline_2 = PolyLine(Vertices=point_2, Closed=False)
linear_array = LinearArray(Geometry=line_sdl, Direction=unit_x, Count=Slider(50, range=0..100))  # -> Geometry, Transform
curve_curve = CurveCurve(CurveA=polyline, CurveB=linear_array.Geometry)  # -> Points, ParamsA, ParamsB
curve_curve_2 = CurveCurve(CurveA=polyline_2, CurveB=linear_array.Geometry)  # -> Points, ParamsA, ParamsB
end_points = EndPoints(Curve=linear_array.Geometry)  # -> Start, End
unit_z = UnitZ(Factor=Slider(84.34, range=0..100))
unit_z_2 = UnitZ(Factor=Slider(60.85, range=0..100))
move = Move(Geometry=curve_curve.Points, Motion=unit_z_2)  # -> simplify(Geometry), Transform
move_2 = Move(Geometry=curve_curve_2.Points, Motion=unit_z)  # -> simplify(Geometry), Transform
point_3 = Point(simplify(graft(end_points.End)))
point_4 = Point(simplify(graft(end_points.Start)))
point_5 = Point([point_3, move.Geometry, move_2.Geometry, point_4])
polyline_3 = PolyLine(Vertices=point_5, Closed=False)
unit_x_2 = UnitX(Factor=Slider(3.1, range=0..10))
extrude = Extrude(Base=polyline_3, Direction=unit_x_2)
