# Grasshopper definition grasshopper commands (dispatch).gh (Grasshopper 1.0.7)
# plug-ins: Bifocals

number_slider = Slider(22, range=0..100)
surface = Surface(<surface referenced from the Rhino model>)
divide_domain² = DivideDomain²(Domain=surface, UCount=number_slider, VCount=number_slider)
gene_pool = GenePool(Decimals=0, Maximum=1, Minimum=0, Value=[1, 1, 0, 0, 1, 0, 0])
isotrim = Isotrim(Surface=surface, Domain=divide_domain²)
dispatch = Dispatch(List=isotrim, DispatchPattern=gene_pool)  # -> ListA, ListB
surface_2 = Surface(dispatch.ListB)
surface_3 = Surface(dispatch.ListA)
custom_preview = CustomPreview(Geometry=surface_3, Material=ColourSwatch(SwatchColor=RGB(212, 255, 0)))
custom_preview_2 = CustomPreview(Geometry=surface_2, Material=ColourSwatch(SwatchColor=RGB(0, 0, 0)))
