# Grasshopper definition grasshopper commands (evaluate surface).gh (Grasshopper 1.0.7)
# plug-ins: Bifocals

curve = Curve(<curve referenced from the Rhino model>)
unit_z = UnitZ(Factor=Slider(260.73, range=0..1000))
extrude = Extrude(Base=curve, Direction=unit_z)
md_slider = MDSlider(SliderMode=0, slider_value=Point(0.5, 0.5, 0.5), x_domain=Domain(0, 1), y_domain=Domain(0, 1), z_domain=Domain(0, 1))
surface = Surface(reparameterize(extrude))
evaluate_surface = EvaluateSurface(Surface=surface, Point=md_slider)  # -> Point, Normal, UDirection, VDirection, Frame
