# Grasshopper definition grasshopper commands (facet dom).gh (Grasshopper 1.0.7)
# plug-ins: Bifocals, Weaverbird

unit_z = UnitZ(Factor=1)
point = Point(Point(44.78868855, 0, 0))
point_2 = Point(Point(45.85578171, 0, 49.67984509))
point_3 = Point(Point(0, 0, 79.89613935))
start = Start(Point(0, 0, 0))
arc_3pt = Arc3Pt(PointA=point, PointB=point_2, PointC=point_3)  # -> Arc, Plane, Radius
line_sdl = LineSDL(Start=start, Direction=unit_z, Length=1)
pi = Pi(Factor=Slider(2, range=0..2))
revolution = Revolution(Curve=arc_3pt.Arc, Axis=line_sdl, Domain=pi)
populate_geometry = PopulateGeometry(Geometry=revolution, Count=Slider(300, range=0..1000), Seed=Slider(3, range=1..10))
facet_dome = FacetDome(Points=populate_geometry, Radius=Slider(32.41, range=1..100))  # -> Pattern, Dome
pull_curve = PullCurve(Curve=facet_dome.Pattern, Surface=revolution)
explode = Explode(Curve=pull_curve, Recursive=True)  # -> Segments, Vertices
polyline = PolyLine(Vertices=explode.Vertices, Closed=True)
polygon_center = PolygonCenter(Polyline=polyline)  # -> CenterV, CenterE, CenterA
point_4 = Point(polygon_center.CenterV)
scale = Scale(Geometry=polyline, Center=point_4, Factor=Slider(0.8, range=0..1))  # -> Geometry, Transform
loft = Loft(
    Curves=[polyline, scale.Geometry],
    Options={Adjust=False, Closed=False, LoftEnds=0, LoftSimp=0, LoftType=0, Rebuild=10, Refit=0.01})
simple_mesh = SimpleMesh(Brep=loft)  # -> flatten(Mesh)
weaverbird_s_join_meshes_and_weld = WeaverbirdsJoinMeshesAndWeld(Mesh=simple_mesh, Weld=True)
weaverbird_s_catmull_clark_subdivision = WeaverbirdsCatmullClarkSubdivision(MeshCurves=weaverbird_s_join_meshes_and_weld, Level=Slider(2, range=0..10), SmoothNakedEdges=1)
weaverbird_s_mesh_thicken = WeaverbirdsMeshThicken(MeshCurves=weaverbird_s_catmull_clark_subdivision, Distance=Slider(5, range=1..10), OffsetType=0)
colour_picker = ColourPicker(PickedColour=RGB(238, 44, 156))
custom_preview = CustomPreview(Geometry=weaverbird_s_mesh_thicken, Material=colour_picker)
