# Grasshopper definition grasshopper commands (fillet edge).gh (Grasshopper 1.0.7)
# plug-ins: Bifocals

point = Point([Point(-84.85266638, -41.04453373, 0), Point(-74.18924597, -13.18150674, 0), Point(0.5083045196, 29.99012038, 0), Point(30.65326278, 70.5813513, 0), Point(110.6418649, 47.30108651, 0), Point(90.64471435, 3.128276392, 0), Point(45.89503119, -25.75021083, 0), Point(-0.3870902801, -104.6175645, 0), Point(-61.57240159, -64.62326345, 0)])
polyline = PolyLine(Vertices=point, Closed=Toggle(True))
unit_z = UnitZ(Factor=Slider(51.37, range=0..100))
surface = Surface(polyline)
extrude = Extrude(Base=surface, Direction=unit_z)
deconstruct_brep = DeconstructBrep(Brep=extrude)  # -> Faces, Edges, Vertices
list_item = ListItem(List=deconstruct_brep.Faces, Index=[Slider(10, range=0..10), Slider(0, range=0..10)], Wrap=True)
value_list = ValueList({"Fillet": 0, "Chamfer": 1, "Blend": 2}, selected="Blend")
deconstruct_brep_2 = DeconstructBrep(Brep=list_item)  # -> Faces, Edges, Vertices
point_on_curve = PointOnCurve(deconstruct_brep.Edges, parameter=0.5)
point_on_curve_2 = PointOnCurve(deconstruct_brep_2.Edges, parameter=0.5)
member_index = MemberIndex(Set=point_on_curve, Member=point_on_curve_2)  # -> flatten(Index), Count
fillet_edge = FilletEdge(
    Shape=extrude,
    Blend=value_list,
    Metric=Slider(2, range=0..2),
    Edges=member_index.Index,
    Radii=Slider(13.17, range=0..50))
deconstruct_brep_3 = DeconstructBrep(Brep=fillet_edge)  # -> Faces, Edges, Vertices
is_planar = IsPlanar(Surface=deconstruct_brep_3.Faces, Interior=True)  # -> Planar, Plane
dispatch = Dispatch(List=deconstruct_brep_3.Faces, DispatchPattern=is_planar.Planar)  # -> ListA, ListB
surface_2 = Surface(dispatch.ListB)
surface_3 = Surface(dispatch.ListA)
