# Grasshopper definition grasshopper commands (graph mapper).gh (Grasshopper 1.0.7)
# plug-ins: Bifocals

unit_y = UnitY(Factor=1)
start = Start(Point(0, 0, 0))
line_sdl = LineSDL(Start=start, Direction=unit_y, Length=Slider(150, range=0..1000))
unit_x = UnitX(Factor=Slider(8, range=0..10))
number_slider = Slider(72, range=0..100)
linear_array = LinearArray(Geometry=line_sdl, Direction=unit_x, Count=number_slider)  # -> Geometry, Transform
number_slider_2 = Slider(2.3, range=0..10)
unit_x_2 = UnitX(Factor=1)
point_on_curve = PointOnCurve(linear_array.Geometry, parameter=0.5)
range = Range(Domain=Domain(0, 1), Steps=expr("x-1", number_slider))
number_slider_3 = Slider(17, range=0..100)
graph_mapper = GraphMapper(range, x0=0, x1=1, y0=0, y1=1, container_name="Sine", Equation_px=[0, 0.2993907034], Equation_py=[0, 0.6882369518])
graph_mapper_2 = GraphMapper(
    graph_mapper,
    x0=0,
    x1=1,
    y0=0,
    y1=1,
    container_name="Sine",
    Equation_px=[0, 0.3428488374],
    Equation_py=[0, 0.4062586427])
construct_domain = ConstructDomain(DomainStart=expr("-x", number_slider_3), DomainEnd=number_slider_3)
bounds = Bounds(Numbers=graph_mapper_2)
remap_numbers = RemapNumbers(Value=graph_mapper, Source=bounds, Target=construct_domain)  # -> Mapped, Clipped
rotate_3d = Rotate3D(Geometry=linear_array.Geometry, Angle=degrees(remap_numbers.Mapped), Center=point_on_curve, Axis=unit_x_2)  # -> Geometry, Transform
unit_z = UnitZ(Factor=Slider(10, range=0..10))
extrude = Extrude(Base=rotate_3d.Geometry, Direction=unit_z)
unit_x_3 = UnitX(Factor=Slider(3, range=0..10))
extrude_2 = Extrude(Base=extrude, Direction=unit_x_3)
deconstruct_brep = DeconstructBrep(Brep=extrude_2)  # -> Faces, Edges, Vertices
brep_edges = BrepEdges(Brep=extrude_2)  # -> Naked, Interior, NonManifold
custom_preview = CustomPreview(Geometry=extrude_2, Material=ColourSwatch(SwatchColor=RGB(2, 0, 130)))
custom_preview_2 = CustomPreview(Geometry=[brep_edges.Naked, brep_edges.Interior], Material=ColourSwatch(SwatchColor=RGB(255, 0, 130)))

number_slider_4 = Slider(5, range=0..10)  # disabled
number_slider_5 = Slider(6, range=0..10)  # disabled
md_slider = MDSlider(
    SliderMode=0,
    slider_value=Point(0.4998267389, 0.9031390679, 0.5),
    x_domain=Domain(0, 1),
    y_domain=Domain(0, 1),
    z_domain=Domain(0, 1))  # disabled
list_item = ListItem(List=deconstruct_brep.Faces, Index=[number_slider_5, number_slider_4], Wrap=True)  # disabled
evaluate_surface = EvaluateSurface(Surface=reparameterize(list_item), Point=md_slider)  # -> flatten(Point), Normal, UDirection, VDirection, Frame; disabled
number_slider_6 = Slider(1, range=0..1)  # disabled
number_slider_7 = Slider(1, range=0..1)  # disabled
circle = Circle(Plane=evaluate_surface.Frame, Radius=number_slider_2)  # -> flatten(Circle); disabled
interpolate = Interpolate(Vertices=evaluate_surface.Point, Degree=number_slider_6, Periodic=False, KnotStyle=1)  # -> Curve, Length, Domain; disabled
list_item_2 = ListItem(List=circle, Index=number_slider_7, Wrap=True)  # disabled
sweep1 = Sweep1(Rail=interpolate.Curve, Sections=list_item_2, Miter=1)  # disabled

number_slider_8 = Slider(5, range=0..10)  # disabled
number_slider_9 = Slider(6, range=0..10)  # disabled
md_slider_2 = MDSlider(
    SliderMode=0,
    slider_value=Point(0.4888608871, 0.09809763839, 0.5),
    x_domain=Domain(0, 1),
    y_domain=Domain(0, 1),
    z_domain=Domain(0, 1))  # disabled
list_item_3 = ListItem(List=deconstruct_brep.Faces, Index=[number_slider_9, number_slider_8], Wrap=True)  # disabled
evaluate_surface_2 = EvaluateSurface(Surface=reparameterize(list_item_3), Point=md_slider_2)  # -> flatten(Point), Normal, UDirection, VDirection, Frame; disabled
number_slider_10 = Slider(1, range=0..1)  # disabled
circle_2 = Circle(Plane=evaluate_surface_2.Frame, Radius=number_slider_2)  # -> flatten(Circle); disabled
interpolate_2 = Interpolate(Vertices=evaluate_surface_2.Point, Degree=3, Periodic=False, KnotStyle=1)  # -> Curve, Length, Domain; disabled
list_item_4 = ListItem(List=circle_2, Index=number_slider_10, Wrap=True)  # disabled
sweep1_2 = Sweep1(Rail=interpolate_2.Curve, Sections=list_item_4, Miter=1)  # disabled

number_slider_11 = Slider(5, range=0..10)  # disabled
number_slider_12 = Slider(6, range=0..10)  # disabled
list_item_5 = ListItem(List=deconstruct_brep.Faces, Index=[number_slider_12, number_slider_11], Wrap=True)  # disabled
md_slider_3 = MDSlider(
    SliderMode=0,
    slider_value=Point(0.4958637853, 0.5024825305, 0.5),
    x_domain=Domain(0, 1),
    y_domain=Domain(0, 1),
    z_domain=Domain(0, 1))  # disabled
evaluate_surface_3 = EvaluateSurface(Surface=reparameterize(list_item_5), Point=md_slider_3)  # -> flatten(Point), Normal, UDirection, VDirection, Frame; disabled
number_slider_13 = Slider(1, range=0..1)  # disabled
number_slider_14 = Slider(1, range=0..1)  # disabled
circle_3 = Circle(Plane=evaluate_surface_3.Frame, Radius=number_slider_2)  # -> flatten(Circle); disabled
interpolate_3 = Interpolate(Vertices=evaluate_surface_3.Point, Degree=number_slider_13, Periodic=False, KnotStyle=1)  # -> Curve, Length, Domain; disabled
list_item_6 = ListItem(List=circle_3, Index=number_slider_14, Wrap=True)  # disabled
sweep1_3 = Sweep1(Rail=interpolate_3.Curve, Sections=list_item_6, Miter=1)  # disabled

cap_holes = CapHoles(Brep=[sweep1_3, sweep1, sweep1_2])  # disabled
colour_swatch = ColourSwatch(SwatchColor=RGB(0, 10, 130))  # disabled
custom_preview_3 = CustomPreview(Geometry=cap_holes, Material=colour_swatch)  # disabled
