# Grasshopper definition grasshopper commands (import PDB).gh (Grasshopper 1.0.7)
# plug-ins: Bifocals

file_path = FilePath("D:\Users\dhruv\Downloads\6d80.pdb")
import_pdb = ImportPDB(File=file_path)  # -> Atoms, Bonds
atom_data = AtomData(Atom=import_pdb.Atoms)  # -> Point, Element, Chain, Residue, Charge, Occupancy, Temperature, AtomicNumber, SerialNumber, ResidueNumber
bounds = Bounds(Numbers=atom_data.Temperature)  # disabled
cull_duplicates = CullDuplicates(Points=atom_data.Point, Tolerance=Slider(5, range=0..10), CullMode=3)  # -> Points, Indices, Valence
remap_numbers = RemapNumbers(Value=atom_data.Temperature, Source=bounds, Target=Domain(0, 1))  # -> Mapped, Clipped; disabled
list_length = ListLength(List=cull_duplicates.Points)
gradient = Gradient(
    LowerLimit=0,
    UpperLimit=1,
    Parameter=remap_numbers.Mapped,
    stops=[0: RGB(0, 128, 0), 0.448: RGB(255, 255, 0), 1: RGB(255, 0, 0)])  # disabled
bounding_box = BoundingBox(Content=cull_duplicates.Points, Plane=PlaneXY(0, 0, 0), UnionBox=True)  # -> Box, Box_2
number_slider = Slider(1.42, range=0..10)  # disabled
deconstruct_brep = DeconstructBrep(Brep=bounding_box.Box)  # -> Faces, Edges, Vertices
repeat_data = RepeatData(Data=Slider(0.8, range=0..1), Length=list_length)
list_item = ListItem(List=deconstruct_brep.Edges, Index=Slider(8, range=0..10), Wrap=True)
cloud_display = CloudDisplay(Points=atom_data.Point, Colours=gradient, Size=number_slider, SpriteType=1)  # disabled
perp_frames = PerpFrames(Curve=list_item, Count=Slider(40, range=0..100), Align=True)  # -> Frames, Parameters
metaball_t_custom = MetaBallTCustom(Points=cull_duplicates.Points, Charge=repeat_data, Plane=perp_frames.Frames, Threshold=0.5)
unit_z = UnitZ(Factor=Slider(10, range=0..100))
extrude = Extrude(Base=metaball_t_custom, Direction=unit_z)
cap_holes = CapHoles(Brep=extrude)
custom_preview = CustomPreview(Geometry=cap_holes, Material=ColourSwatch(SwatchColor=RGB(10, 10, 255)))  # disabled
