# Grasshopper definition grasshopper commands (mirror curve).gh (Grasshopper 1.0.7)
# plug-ins: Bifocals, LunchBox

point = Point([Point(-174.8024723, -22.2429797, 0), Point(-110.4471991, 58.8153374, 0), Point(2.281581069, 61.2723591, 0), Point(125.9224996, 65.87171552, 0)])
point_2 = Point([Point(-144.4924573, -56.45276526, 0), Point(-82.6230764, -9.800621644, 0), Point(-30.95367501, 21.40314099, 0), Point(25.33077297, 40.55983989, 0), Point(167.952011, 36.65779902, 0)])
interpolate = Interpolate(Vertices=point, Degree=3, Periodic=False, KnotStyle=1)  # -> Curve, Length, Domain
interpolate_2 = Interpolate(Vertices=point_2, Degree=3, Periodic=False, KnotStyle=1)  # -> Curve, Length, Domain
mirror_curve = MirrorCurve(Geometry=interpolate.Curve, Curve=interpolate_2.Curve, Tangent=True)
curve = Curve(interpolate.Curve)
curve_2 = Curve(mirror_curve)
point_on_curve = PointOnCurve(curve_2, parameter=1)
point_on_curve_2 = PointOnCurve(curve, parameter=1)
point_on_curve_3 = PointOnCurve(curve_2, parameter=0)
point_on_curve_4 = PointOnCurve(curve, parameter=0)
line = Line(StartPoint=point_on_curve_2, EndPoint=point_on_curve)
line_2 = Line(StartPoint=point_on_curve_4, EndPoint=point_on_curve_3)
unit_z = UnitZ(Factor=Slider(44.79, range=0..100))
point_on_curve_5 = PointOnCurve(line, parameter=0.5)
unit_z_2 = UnitZ(Factor=Slider(66.76, range=0..100))
point_on_curve_6 = PointOnCurve(line_2, parameter=0.5)
move = Move(Geometry=point_on_curve_5, Motion=unit_z)  # -> Geometry, Transform
move_2 = Move(Geometry=point_on_curve_6, Motion=unit_z_2)  # -> Geometry, Transform
point_3 = Point(point_on_curve_2)
point_4 = Point(point_on_curve_4)
point_5 = Point(point_on_curve_3)
point_6 = Point(point_on_curve)
arc_3pt = Arc3Pt(PointA=point_3, PointB=move.Geometry, PointC=point_6)  # -> Arc, Plane, Radius
arc_3pt_2 = Arc3Pt(PointA=point_4, PointB=move_2.Geometry, PointC=point_5)  # -> Arc, Plane, Radius
curve_3 = Curve(interpolate.Curve)
curve_4 = Curve(mirror_curve)
sweep2 = Sweep2(Rail1=curve_3, Rail2=curve_4, Sections=[arc_3pt_2.Arc, arc_3pt.Arc], SameHeight=False)
diamond_panels = DiamondPanels(Surface=sweep2, UDivisions=Slider(20, range=0..100), VDivisions=Slider(20, range=0..100))  # -> DiamondPanels, TriPanels
panel_frame = PanelFrame(Panel=diamond_panels.TriPanels, ScaleFactor=Slider(0.6, range=0..1))  # -> PanelFrame, Panel
panel_frame_2 = PanelFrame(Panel=diamond_panels.DiamondPanels, ScaleFactor=Slider(0.8, range=0..1))  # -> PanelFrame, Panel
colour_picker = ColourPicker(PickedColour=RGB(84, 255, 128))
colour_picker_2 = ColourPicker(PickedColour=RGB(0, 0, 128))
custom_preview = CustomPreview(Geometry=[panel_frame_2.PanelFrame, panel_frame.PanelFrame], Material=colour_picker)
custom_preview_2 = CustomPreview(Geometry=[panel_frame.Panel, panel_frame_2.Panel], Material=colour_picker_2)
