# Grasshopper definition grasshopper commands (octree).gh (Grasshopper 1.0.7)
# plug-ins: Bifocals, Weaverbird

number_slider = Slider(150, range=0..1000)
center_box = CenterBox(Base=PlaneXY(0, 0, 0), X=number_slider, Y=number_slider, Z=number_slider)
populate_geometry = PopulateGeometry(Geometry=center_box, Count=Slider(288, range=0..1000), Seed=Slider(10, range=0..10))
octree = OcTree(Points=populate_geometry, Square=Toggle(False), Group=Slider(-10, range=-10..10))  # -> Boxes, Points
number_slider_2 = Slider(8.5, range=0..100)
box = Box(octree.Boxes)
simple_mesh = SimpleMesh(Brep=box)
weaverbird_s_picture_frame = WeaverbirdsPictureFrame(MeshPolylines=simple_mesh, Distance=number_slider_2, InsetType=0)
weaverbird_s_mesh_window = WeaverbirdsMeshWindow(MeshPolylines=simple_mesh, Distance=number_slider_2, InsetType=0)
number_slider_3 = Slider(1, range=0..10)
weaverbird_s_mesh_thicken = WeaverbirdsMeshThicken(MeshCurves=weaverbird_s_picture_frame, Distance=number_slider_3, OffsetType=0)
weaverbird_s_mesh_thicken_2 = WeaverbirdsMeshThicken(MeshCurves=weaverbird_s_mesh_window, Distance=number_slider_3, OffsetType=0)
custom_preview = CustomPreview(Geometry=weaverbird_s_mesh_thicken, Material=ColourSwatch(SwatchColor=RGB(18, 21, 113)))
custom_preview_2 = CustomPreview(Geometry=weaverbird_s_mesh_thicken_2, Material=ColourSwatch(SwatchColor=RGBA(253, 14, 255, 118)))
