# Grasshopper definition grasshopper commands (perp frames).gh (Grasshopper 1.0.7)
# plug-ins: Bifocals

gene_pool = GenePool(Decimals=2, Maximum=40, Minimum=-20, Value=[-20, -20, 40, 40])
curve = Curve(<curve referenced from the Rhino model>)
number_slider = Slider(39, range=0..50)
list_length = ListLength(List=gene_pool)
multiplication = Multiplication(A=Slider(10, range=0..100), B=list_length)
perp_frames = PerpFrames(Curve=curve, Count=multiplication, Align=True)  # -> Frames, Parameters
deconstruct_plane = DeconstructPlane(Plane=perp_frames.Frames)  # -> Origin, XAxis, YAxis, ZAxis
negative = Negative(Value=number_slider)
number = Number([number_slider, Slider(0, range=0..10), negative, Slider(0, range=0..10)])
repeat_data = RepeatData(Data=gene_pool, Length=multiplication)
repeat_data_2 = RepeatData(Data=number, Length=multiplication)
multiplication_2 = Multiplication(A=deconstruct_plane.XAxis, B=repeat_data)
multiplication_3 = Multiplication(A=deconstruct_plane.YAxis, B=repeat_data_2)
addition = Addition(A=multiplication_2, B=multiplication_3)
move = Move(Geometry=deconstruct_plane.Origin, Motion=addition)  # -> Geometry, Transform
interpolate = Interpolate(Vertices=move.Geometry, Degree=3, Periodic=True, KnotStyle=1)  # -> Curve, Length, Domain
pipe = Pipe(Curve=interpolate.Curve, Radius=Slider(5, range=0..10), Caps=0)
