# Grasshopper definition grasshopper commands (pollar arrays).gh (Grasshopper 1.0.7)
# plug-ins: Bifocals

md_slider = MDSlider(SliderMode=0, slider_value=Point(0, 0, 0.5), x_domain=Domain(0, 1), y_domain=Domain(0, 1), z_domain=Domain(0, 1))
point = Point(<point referenced from the Rhino model>)
rotate_plane = RotatePlane(Plane=point, Angle=degrees(Slider(124.09, range=0..180)))
polygon = Polygon(Plane=rotate_plane, Radius=Slider(20, range=20..30), Segments=Slider(3, range=3..20), FilletRadius=Slider(0, range=0..1))  # -> Polygon, Length
curve = Curve(<curve referenced from the Rhino model>)
multiplication = Multiplication(A=md_slider, B=Slider(100, range=0..100))
curve_2 = Curve(<curve referenced from the Rhino model>)
multiplication_2 = Multiplication(A=md_slider, B=Slider(100, range=0..100))
polar_array = PolarArray(Geometry=curve, Plane=multiplication, Count=Slider(22, range=3..22), Angle=degrees(Slider(360, range=0..360)))  # -> Geometry, Transform
polar_array_2 = PolarArray(
    Geometry=polygon.Polygon,
    Plane=multiplication_2,
    Count=Slider(22, range=4..30),
    Angle=degrees(Slider(360, range=0..360)))  # -> Geometry, Transform
region_union = RegionUnion(Curves=polar_array.Geometry)
number_slider = Slider(2, range=0..10)
region_union_2 = RegionUnion(Curves=polar_array_2.Geometry)
negative = Negative(Value=number_slider)
offset_curve = OffsetCurve(Curve=region_union, Distance=Slider(1.88, range=1..10), Plane=PlaneXY(0, 0, 0), Corners=1)
offset_curve_2 = OffsetCurve(Curve=region_union_2, Distance=Slider(1.88, range=1..10), Plane=PlaneXY(0, 0, 0), Corners=1)
negative_2 = Negative(Value=Slider(2, range=0..10))
unit_z = UnitZ(Factor=negative)
boundary_surfaces = BoundarySurfaces(Edges=region_union)
boundary_surfaces_2 = BoundarySurfaces(Edges=region_union_2)
boundary_surfaces_3 = BoundarySurfaces(Edges=offset_curve)
unit_z_2 = UnitZ(Factor=number_slider)
unit_z_3 = UnitZ(Factor=negative_2)
move = Move(Geometry=boundary_surfaces_3, Motion=unit_z_3)  # -> Geometry, Transform
negative_3 = Negative(Value=Slider(3, range=0..10))
extrude = Extrude(Base=boundary_surfaces_2, Direction=unit_z_2)
circle = Circle(Plane=md_slider, Radius=Slider(121.66, range=0..1000))
extrude_2 = Extrude(Base=boundary_surfaces, Direction=unit_z)
extrude_3 = Extrude(Base=move.Geometry, Direction=unit_z_3)
unit_z_4 = UnitZ(Factor=negative_3)
move_2 = Move(Geometry=circle, Motion=unit_z_4)  # -> Geometry, Transform
custom_preview = CustomPreview(Geometry=extrude, Material=ColourSwatch(SwatchColor=RGB(185, 0, 0)))
custom_preview_2 = CustomPreview(Geometry=extrude_2, Material=ColourSwatch(SwatchColor=RGB(109, 4, 0)))
boundary_surfaces_4 = BoundarySurfaces(Edges=move_2.Geometry)
custom_preview_3 = CustomPreview(Geometry=extrude_3, Material=ColourSwatch(SwatchColor=RGB(0, 0, 0)))
extrude_4 = Extrude(Base=boundary_surfaces_4, Direction=unit_z_4)
custom_preview_4 = CustomPreview(Geometry=extrude_4, Material=ColourSwatch(SwatchColor=RGB(166, 0, 0)))
