# Grasshopper definition grasshopper commands (random).gh (Grasshopper 1.0.7)
# plug-ins: Bifocals

radians = Radians(Degrees=Slider(180, range=0..360))
arc = Arc(Plane=PlaneXY(0, 0, 0), Radius=Slider(49.1, range=0..100), Angle=radians)  # -> Arc, Length
unit_z = UnitZ(Factor=Slider(211.41, range=0..1000))
extrude = Extrude(Base=arc.Arc, Direction=unit_z)
number_slider = Slider(12, range=0..100)
md_slider = MDSlider(SliderMode=0, slider_value=Point(0.5, 0.5, 0.5), x_domain=Domain(0, 1), y_domain=Domain(0, 1), z_domain=Domain(0, 1))
divide_domain² = DivideDomain²(Domain=extrude, UCount=number_slider, VCount=number_slider)
isotrim = Isotrim(Surface=extrude, Domain=divide_domain²)
construct_domain = ConstructDomain(DomainStart=Slider(-9.3, range=-20..11), DomainEnd=Slider(20, range=0..100))
list_length = ListLength(List=isotrim)
evaluate_surface = EvaluateSurface(Surface=reparameterize(isotrim), Point=md_slider)  # -> Point, expr("-x", Normal), UDirection, VDirection, Frame
random = Random(Range=construct_domain, Number=list_length, Seed=Slider(2, range=0..10))
vector = Vector(evaluate_surface.Normal)
multiplication = Multiplication(A=vector, B=random)
bounds = Bounds(Numbers=random)
extrude_2 = Extrude(Base=isotrim, Direction=multiplication)
remap_numbers = RemapNumbers(Value=random, Source=bounds, Target=Domain(0, 1))  # -> Mapped, Clipped
gradient = Gradient(
    LowerLimit=0,
    UpperLimit=1,
    Parameter=remap_numbers.Mapped,
    stops=[0: RGB(0, 128, 0), 0.5: RGB(255, 255, 0), 1: RGB(255, 0, 0)])
custom_preview = CustomPreview(Geometry=extrude_2, Material=gradient)
