# Grasshopper definition grasshopper commands (rotate axis).gh (Grasshopper 1.0.7)
# plug-ins: Bifocals

plane_surface = PlaneSurface(Plane=PlaneXY(0, 0, 0), XSize=Slider(19.5, range=0..100), YSize=Slider(311.9, range=0..500))
deconstruct_brep = DeconstructBrep(Brep=plane_surface)  # -> Faces, Edges, Vertices
list_item = ListItem(List=deconstruct_brep.Edges, Index=Slider(3, range=0..4), Wrap=True)
rotate_axis = RotateAxis(Geometry=plane_surface, Angle=degrees(Slider(82, range=0..90)), Axis=list_item)  # -> Geometry, Transform
deconstruct_brep_2 = DeconstructBrep(Brep=rotate_axis.Geometry)  # -> Faces, Edges, Vertices
list_item_2 = ListItem(List=deconstruct_brep_2.Vertices, Index=0, Wrap=True)  # -> Item, Item1
yz_plane = YZPlane(Origin=list_item_2.Item1)
deconstruct = Deconstruct(Point=list_item_2.Item1)  # -> XComponent, YComponent, ZComponent
mirror = Mirror(Geometry=rotate_axis.Geometry, Plane=yz_plane)  # -> Geometry, Transform
unit_x = UnitX(Factor=expr("2*x", deconstruct.XComponent))
linear_array = LinearArray(Geometry=[rotate_axis.Geometry, mirror.Geometry], Direction=unit_x, Count=Slider(15, range=0..100))  # -> Geometry, Transform
