# Grasshopper definition grasshopper commands (series).gh (Grasshopper 1.0.7)
# plug-ins: Bifocals

construct_domain = ConstructDomain(DomainStart=0, DomainEnd=1)
series = Series(Start=Slider(0, range=0..100), Step=Slider(1, range=0..10), Count=Slider(300, range=0..300))
number = Number(series)
bounds = Bounds(Numbers=number)
remap_numbers = RemapNumbers(Value=number, Source=bounds, Target=construct_domain)  # -> Mapped, Clipped
graph_mapper = GraphMapper(remap_numbers.Mapped, x0=0, x1=1, y0=0, y1=1, container_name="Sine", Equation_px=[0, 1], Equation_py=[0, 1])
graph_mapper_2 = GraphMapper(remap_numbers.Mapped, x0=0, x1=1, y0=0, y1=1, container_name="Sine", Equation_px=[0, 1], Equation_py=[0, 1])
number_2 = Number(graph_mapper)
bounds_2 = Bounds(Numbers=number_2)
construct_domain_2 = ConstructDomain(DomainStart=Slider(15.5, range=0..100), DomainEnd=Slider(170, range=0..400))
number_3 = Number(graph_mapper_2)
bounds_3 = Bounds(Numbers=number_3)
construct_domain_3 = ConstructDomain(DomainStart=Slider(0, range=0..100), DomainEnd=Slider(89, range=0..400))
remap_numbers_2 = RemapNumbers(Value=number_2, Source=bounds_2, Target=construct_domain_2)  # -> Mapped, Clipped
remap_numbers_3 = RemapNumbers(Value=number_3, Source=bounds_3, Target=construct_domain_3)  # -> Mapped, Clipped
construct_point = ConstructPoint(XCoordinate=series, YCoordinate=remap_numbers_3.Mapped, ZCoordinate=remap_numbers_2.Mapped)
interpolate = Interpolate(Vertices=construct_point, Degree=3, Periodic=False, KnotStyle=1)  # -> Curve, Length, Domain
pipe = Pipe(Curve=interpolate.Curve, Radius=Slider(1.3, range=0..10), Caps=0)
custom_preview = CustomPreview(Geometry=pipe, Material=ColourSwatch(SwatchColor=RGB(0, 136, 67)))
