# Grasshopper definition grasshopper commands (sinecosine).gh (Grasshopper 1.0.7)
# plug-ins: Bifocals

series = Series(Start=Slider(0, range=0..15), Step=Slider(0.1, range=0..1), Count=Slider(100, range=0..100))
cosine = Cosine(Value=series)
sine = Sine(Value=series)
multiplication = Multiplication(A=cosine, B=Slider(2.4, range=0..10))
multiplication_2 = Multiplication(A=sine, B=Slider(1, range=0..10))
square = Square(Value=multiplication)
multiplication_3 = Multiplication(A=multiplication_2, B=square)
construct_point = ConstructPoint(XCoordinate=series, YCoordinate=0, ZCoordinate=multiplication_3)
interpolate = Interpolate(Vertices=construct_point, Degree=3, Periodic=False, KnotStyle=1)  # -> Curve, Length, Domain
