# Grasshopper definition grasshopper commands (substrate).gh (Grasshopper 1.0.7)
# plug-ins: Bifocals

plane = Plane(PlaneXY(0, 0, 0))
radians = Radians(Degrees=Slider(90, range=0..90))
radians_2 = Radians(Degrees=Slider(0, range=0..90))
rectangle = Rectangle(Plane=plane, XSize=Slider(50, range=0..100), YSize=Slider(49.6, range=0..100), Radius=0)  # -> Rectangle, Length
construct_domain = ConstructDomain(DomainStart=Slider(2, range=0..10), DomainEnd=Slider(11, range=0..100))
substrate = Substrate(
    Border=rectangle.Rectangle,
    Count=[Slider(77, range=0..100), Slider(19, range=0..100)],
    Angles=radians,
    Deviation=radians_2,
    Seed=5)
surface = Surface(rectangle.Rectangle)
surface_split = SurfaceSplit(Surface=surface, Curves=substrate)
list_length = ListLength(List=surface_split)
random = Random(Range=construct_domain, Number=list_length, Seed=Slider(3, range=0..20))
unit_z = UnitZ(Factor=random)
extrude = Extrude(Base=surface_split, Direction=unit_z)
random_reduce = RandomReduce(List=extrude, Reduction=Slider(0, range=0..10), Seed=Slider(3.176, range=0..10))
custom_preview = CustomPreview(Geometry=random_reduce, Material=ColourSwatch(SwatchColor=RGB(29, 216, 120)))
