# Grasshopper definition grasshopper commands (surface box).gh (Grasshopper 1.0.7)
# plug-ins: Bifocals

surface = Surface(reparameterize(<surface referenced from the Rhino model>))
area = Area(Geometry=surface)  # -> Area, Centroid
number_slider = Slider(15, range=0..100)
md_slider = MDSlider(
    SliderMode=0,
    slider_value=Point(0.4275797539, 0.5119982464, 0.5),
    x_domain=Domain(0, 1),
    y_domain=Domain(0, 1),
    z_domain=Domain(0, 1))
scale = Scale(Geometry=surface, Center=area.Centroid, Factor=Slider(3, range=0..10))  # -> Geometry, Transform
divide_domain² = DivideDomain²(Domain=scale.Geometry, UCount=number_slider, VCount=number_slider)
evaluate_surface = EvaluateSurface(Surface=reparameterize(scale.Geometry), Point=md_slider)  # -> Point, Normal, UDirection, VDirection, Frame
isotrim = Isotrim(Surface=scale.Geometry, Domain=divide_domain²)
area_2 = Area(Geometry=isotrim)  # -> Area, Centroid
closest_point = ClosestPoint(Point=area_2.Centroid, Cloud=evaluate_surface.Point)  # -> ClosestPoint, CPIndex, Distance
bounds = Bounds(Numbers=closest_point.Distance)
construct_domain = ConstructDomain(DomainStart=Slider(13.88, range=0..100), DomainEnd=Slider(0, range=0..100))
remap_numbers = RemapNumbers(Value=closest_point.Distance, Source=bounds, Target=construct_domain)  # -> Mapped, Clipped
surface_box = SurfaceBox(Surface=scale.Geometry, Domain=divide_domain², Height=remap_numbers.Mapped)
geometry = Geometry(<brep referenced from the Rhino model>)
box = Box(geometry)
box_morph = BoxMorph(Geometry=geometry, Reference=box, Target=surface_box)
