# Grasshopper definition grasshopper commands (sweep1).gh (Grasshopper 1.0.7)
# plug-ins: Bifocals

curve = Curve(reparameterize(<curve referenced from the Rhino model>))
curve_2 = Curve(<curve referenced from the Rhino model>)
area = Area(Geometry=curve_2)  # -> Area, Centroid
perp_frame = PerpFrame(Curve=curve, Parameter=Slider(0, range=0..100))
orient = Orient(Geometry=curve_2, Source=area.Centroid, Target=perp_frame)  # -> Geometry, Transform
sweep1 = Sweep1(Rail=curve, Sections=orient.Geometry, Miter=1)
