# Grasshopper definition grasshopper commands (twist).gh (Grasshopper 1.0.7)
# plug-ins: Bifocals

number_slider = Slider(50.23, range=0..100)
domain_box = DomainBox(Base=PlaneXY(0, 0, 0), X=number_slider, Y=number_slider, Z=Slider(336.13, range=0..1000))
deconstruct_brep = DeconstructBrep(Brep=domain_box)  # -> Faces, Edges, Vertices
list_item = ListItem(List=deconstruct_brep.Faces, Index=Slider(4, range=0..10), Wrap=True)

# ---- group: Parameters
md_slider = MDSlider(SliderMode=0, slider_value=Point(0, 1, 0.5), x_domain=Domain(0, 1), y_domain=Domain(0, 1), z_domain=Domain(0, 1))
number_slider_2 = Slider(1, range=0..1)
angle_of_twist = Slider(180, range=0..180)
number_slider_3 = Slider(0, range=0..1)
boolean_toggle = BooleanToggle(True)
colour_swatch = ColourSwatch(SwatchColor=RGB(56, 171, 255))

# ----
evaluate_surface = EvaluateSurface(Surface=reparameterize(list_item), Point=md_slider)  # -> Point, Normal, UDirection, VDirection, Frame
unit_z = UnitZ(Factor=1)
project_point = ProjectPoint(Point=evaluate_surface.Point, Direction=unit_z, Geometry=domain_box)  # -> Point, Index
line = Line(StartPoint=evaluate_surface.Point, EndPoint=project_point.Point)
construct_domain = ConstructDomain(DomainStart=number_slider_3, DomainEnd=number_slider_2)
sub_curve = SubCurve(BaseCurve=reparameterize(line), Domain=construct_domain)
twist = Twist(Geometry=domain_box, Axis=sub_curve, Angle=degrees(angle_of_twist), Infinite=boolean_toggle, Rigid=False)
deconstruct_brep_2 = DeconstructBrep(Brep=twist)  # -> Faces, Edges, Vertices
custom_preview = CustomPreview(Geometry=twist, Material=colour_swatch)
