# Grasshopper definition grasshopper commands (voronoi 3d).gh (Grasshopper 1.0.7)
# plug-ins: Bifocals

# ---- group: basic voronoi 3d
number_slider = Slider(21, range=0..100)  # disabled
number_slider_2 = Slider(60, range=0..100)  # disabled
box = Box({Plane=PlaneXY(117.0252488, 96.52695662, 0), X=Domain(0, 250), Y=Domain(0, 250), Z=Domain(0, 250)})  # disabled
populate_geometry = PopulateGeometry(Geometry=box, Count=number_slider_2, Seed=number_slider)  # disabled
number_slider_3 = Slider(15, range=0..20)  # disabled
number_slider_4 = Slider(67, range=0..100)  # disabled
voronoi_3d = Voronoi3D(Points=populate_geometry, Box=box)  # -> Cells, Boundary; disabled
random_reduce = RandomReduce(List=voronoi_3d.Cells, Reduction=number_slider_3, Seed=number_slider_4)  # disabled
solid_union = SolidUnion(Breps=random_reduce)  # disabled
custom_preview = CustomPreview(
    Geometry=solid_union,
    Material={diffuse=RGB(221, 160, 221), emission=RGB(66, 48, 66), shine=0.5, specular=RGB(255, 255, 255), transparency=0})  # disabled

# ----
box_2 = Box({Plane=PlaneXY(143.6492638, -98.71766099, 0), X=Domain(0, 250), Y=Domain(0, 250), Z=Domain(0, 250)})
point = Point([Point(391.9920821, -86.87312163, 157.0631912), Point(249.9382781, 105.6842053, 270.7888377), Point(202.1746597, -102.4745866, 90.3183697), Point(154.5746048, 137.2210133, 36.48544642), Point(401.3739206, 155.9176526, 52.35829809)])
sphere = Sphere(Base=point, Radius=Slider(73.53, range=0..100))
solid_difference = SolidDifference(BrepsA=box_2, BrepsB=sphere)
volume = Volume(Geometry=solid_difference)  # -> Volume, Centroid
populate_geometry_2 = PopulateGeometry(Geometry=solid_difference, Count=Slider(73, range=0..100), Seed=Slider(100, range=0..100))
scale = Scale(Geometry=solid_difference, Center=volume.Centroid, Factor=Slider(1.325, range=0..10))  # -> Geometry, Transform
voronoi_3d_2 = Voronoi3D(Points=populate_geometry_2, Box=scale.Geometry)  # -> Cells, Boundary
solid_intersection = SolidIntersection(BrepsA=voronoi_3d_2.Cells, BrepsB=solid_difference)
random_reduce_2 = RandomReduce(List=solid_intersection, Reduction=Slider(10, range=0..10), Seed=Slider(10, range=0..10))
volume_2 = Volume(Geometry=random_reduce_2)  # -> Volume, Centroid
solid_union_2 = SolidUnion(Breps=random_reduce_2)
bounds = Bounds(Numbers=volume_2.Volume)
remap_numbers = RemapNumbers(Value=volume_2.Volume, Source=bounds, Target=Domain(0, 1))  # -> Mapped, Clipped
gradient = Gradient(
    LowerLimit=0,
    UpperLimit=1,
    Parameter=remap_numbers.Mapped,
    stops=[0: RGB(243, 57, 0), 0.1: RGB(236, 27, 60), 0.2: RGB(210, 0, 118), 0.3: RGB(103, 0, 120), 0.4: RGB(39, 72, 161), 0.5: RGB(1, 192, 229), 0.6: RGB(18, 178, 90), 0.7: RGB(79, 186, 8), 0.8: RGB(220, 237, 32), 0.9: RGB(247, 159, 20), 1: RGB(243, 57, 0)])
custom_preview_2 = CustomPreview(Geometry=random_reduce_2, Material=gradient)
