# Grasshopper definition grasshopper commands (voronoi cell).gh (Grasshopper 1.0.7)
# plug-ins: Bifocals, Weaverbird

point = Point(Point(12.7154394, -24.97274234, 13.3609128))
point_2 = Point([Point(-43.36318841, -66.12253584, 43.66481416), Point(-0.04236614098, 47.45912518, -22.16893553), Point(53.88287842, 10.7907279, -16.21917462), Point(65.26088523, -16.64515582, 52.53072054), Point(-50.82026323, 15.43224866, -16.44568269), Point(23.28051119, -35.74825254, 6.319280851), Point(17.94930717, -59.09729553, 15.4211867)])
box = Box({Plane=PlaneXY(-49.50671875, -71.72189994, 0), X=Domain(0, 118.7811419), Y=Domain(0, 100.2451512), Z=Domain(0, 57.95010765)})
voronoi_cell = VoronoiCell(Point=point, Neighbours=point_2, Box=box)
deconstruct_brep = DeconstructBrep(Brep=voronoi_cell)  # -> Faces, Edges, Vertices
number_slider = Slider(11.8, range=0..100)
curve = Curve(deconstruct_brep.Faces)
number_slider_2 = Slider(3, range=0..10)
weaverbird_s_picture_frame = WeaverbirdsPictureFrame(MeshPolylines=curve, Distance=number_slider, InsetType=0)
weaverbird_s_mesh_window = WeaverbirdsMeshWindow(MeshPolylines=curve, Distance=number_slider, InsetType=0)
weaverbird_s_catmull_clark_subdivision = WeaverbirdsCatmullClarkSubdivision(MeshCurves=weaverbird_s_picture_frame, Level=number_slider_2, SmoothNakedEdges=1)
weaverbird_s_catmull_clark_subdivision_2 = WeaverbirdsCatmullClarkSubdivision(MeshCurves=weaverbird_s_mesh_window, Level=number_slider_2, SmoothNakedEdges=1)  # disabled
weaverbird_s_join_meshes_and_weld = WeaverbirdsJoinMeshesAndWeld(Mesh=[weaverbird_s_catmull_clark_subdivision_2, weaverbird_s_catmull_clark_subdivision], Weld=True)
weaverbird_s_mesh_thicken = WeaverbirdsMeshThicken(MeshCurves=weaverbird_s_join_meshes_and_weld, Distance=Slider(3, range=0..10), OffsetType=0)
custom_preview = CustomPreview(Geometry=weaverbird_s_mesh_thicken, Material=ColourSwatch(SwatchColor=RGB(37, 29, 255)))
