# Grasshopper definition surface-panneling.gh (Grasshopper 1.0.7)
# plug-ins: Weaverbird

circle = Circle(Plane=PlaneXY(0, 0, 0), Radius=Slider(50, range=15..100))
curve = Curve(reparameterize(circle))
perp_frame = PerpFrame(Curve=curve, Parameter=Slider(0, range=0..1))
circle_2 = Circle(Plane=perp_frame, Radius=Slider(17.87, range=0..25))
sweep1 = Sweep1(Rail=curve, Sections=circle_2, Miter=1)
construct_domain² = ConstructDomain²(UMin=Slider(0, range=0..1), UMax=Slider(1, range=0..1), VMin=Slider(0, range=0..1), VMax=Slider(1, range=0..1))
surface = Surface(reparameterize(sweep1))
isotrim = Isotrim(Surface=surface, Domain=construct_domain²)
divide_domain² = DivideDomain²(Domain=isotrim, UCount=Slider(26.86, range=0..50), VCount=Slider(10, range=0..50))
isotrim_2 = Isotrim(Surface=isotrim, Domain=divide_domain²)
simple_mesh = SimpleMesh(Brep=isotrim_2)
weaverbird_s_picture_frame = WeaverbirdsPictureFrame(MeshPolylines=graft(simple_mesh), Distance=Slider(10, range=0..10), InsetType=0)
mesh = Mesh(flatten(weaverbird_s_picture_frame))
number_slider = Slider(3, range=0..10)
weaverbird_s_join_meshes_and_weld = WeaverbirdsJoinMeshesAndWeld(Mesh=mesh, Weld=True)
weaverbird_s_catmull_clark_subdivision = WeaverbirdsCatmullClarkSubdivision(MeshCurves=weaverbird_s_join_meshes_and_weld, Level=number_slider, SmoothNakedEdges=1)
weaverbird_s_mesh_window = WeaverbirdsMeshWindow(MeshPolylines=graft(simple_mesh), Distance=Slider(10, range=0..10), InsetType=0)
weaverbird_s_catmull_clark_subdivision_2 = WeaverbirdsCatmullClarkSubdivision(MeshCurves=weaverbird_s_mesh_window, Level=number_slider, SmoothNakedEdges=1)
weaverbird_s_mesh_thicken = WeaverbirdsMeshThicken(MeshCurves=weaverbird_s_catmull_clark_subdivision_2, Distance=expr("-X", Slider(2, range=0..10)), OffsetType=0)
weaverbird_s_mesh_thicken_2 = WeaverbirdsMeshThicken(MeshCurves=weaverbird_s_catmull_clark_subdivision, Distance=Slider(2, range=0..10), OffsetType=0)
custom_preview = CustomPreview(Geometry=weaverbird_s_mesh_thicken, Material=ColourSwatch(SwatchColor=RGB(111, 218, 255)))
custom_preview_2 = CustomPreview(Geometry=weaverbird_s_mesh_thicken_2, Material=ColourSwatch(SwatchColor=RGB(0, 0, 71)))
box = Box(weaverbird_s_mesh_thicken_2)
deconstruct_brep = DeconstructBrep(Brep=box)  # -> Faces, Edges, Vertices
list_item = ListItem(List=deconstruct_brep.Edges, Index=Slider(0, range=0..6), Wrap=True)
end_points = EndPoints(Curve=list_item)  # -> Start, End
aligned_dimension = AlignedDimension(
    Plane=PlaneXY(0, 0, 0),
    PointA=end_points.Start,
    PointB=end_points.End,
    Offset=expr("-X", Slider(10, range=0..10)),
    Text="{0:0.00}",
    Size=Slider(4.5, range=0..10))
number_slider_2 = Slider(78, range=15..100)  # disabled
circle_3 = Circle(Plane=PlaneXY(0, 0, 0), Radius=number_slider_2)  # disabled
number_slider_3 = Slider(0, range=0..1)  # disabled
circle_4 = Circle(Plane=PlaneXY(0, 0, 0), Radius=Slider(50, range=15..100))
curve_2 = Curve(reparameterize(circle_3))  # disabled
curve_3 = Curve(reparameterize(circle_4))
number_slider_4 = Slider(17.87, range=0..25)  # disabled
perp_frame_2 = PerpFrame(Curve=curve_2, Parameter=number_slider_3)  # disabled
perp_frame_3 = PerpFrame(Curve=curve_3, Parameter=Slider(0, range=0..1))
number_slider_5 = Slider(1, range=0..1)  # disabled
number_slider_6 = Slider(0, range=0..1)  # disabled
number_slider_7 = Slider(1, range=0..1)  # disabled
number_slider_8 = Slider(0, range=0..1)  # disabled
circle_5 = Circle(Plane=perp_frame_2, Radius=number_slider_4)  # disabled
circle_6 = Circle(Plane=perp_frame_3, Radius=Slider(17.87, range=0..25))
sweep1_2 = Sweep1(Rail=curve_2, Sections=circle_5, Miter=1)  # disabled
construct_domain²_2 = ConstructDomain²(UMin=number_slider_6, UMax=number_slider_7, VMin=number_slider_8, VMax=number_slider_5)  # disabled
surface_2 = Surface(reparameterize(sweep1_2))  # disabled
sweep1_3 = Sweep1(Rail=curve_3, Sections=circle_6, Miter=1)
construct_domain²_3 = ConstructDomain²(UMin=Slider(0, range=0..1), UMax=Slider(1, range=0..1), VMin=Slider(0, range=0..1), VMax=Slider(1, range=0..1))
surface_3 = Surface(reparameterize(sweep1_3))
number_slider_9 = Slider(44.36, range=0..50)  # disabled
number_slider_10 = Slider(15, range=0..50)  # disabled
isotrim_3 = Isotrim(Surface=surface_2, Domain=construct_domain²_2)  # disabled
md_slider = MDSlider(
    SliderMode=0,
    slider_value=Point(0.1759544579, 1, 0.5),
    x_domain=Domain(0, 1),
    y_domain=Domain(0, 1),
    z_domain=Domain(0, 1))
md_slider_2 = MDSlider(SliderMode=0, slider_value=Point(1, 0, 0.5), x_domain=Domain(0, 1), y_domain=Domain(0, 1), z_domain=Domain(0, 1))
isotrim_4 = Isotrim(Surface=surface_3, Domain=construct_domain²_3)
divide_domain²_2 = DivideDomain²(Domain=isotrim_3, UCount=number_slider_9, VCount=number_slider_10)  # disabled
evaluate_surface = EvaluateSurface(Surface=isotrim_4, Point=[md_slider_2, md_slider])  # -> Point, Normal, UDirection, VDirection, Frame
divide_domain²_3 = DivideDomain²(Domain=isotrim_4, UCount=Slider(20, range=0..50), VCount=Slider(10, range=0..50))
isotrim_5 = Isotrim(Surface=isotrim_3, Domain=divide_domain²_2)  # disabled
isotrim_6 = Isotrim(Surface=isotrim_4, Domain=divide_domain²_3)
number_slider_11 = Slider(10, range=0..10)  # disabled
simple_mesh_2 = SimpleMesh(Brep=isotrim_5)  # disabled
area = Area(Geometry=isotrim_6)  # -> Area, Centroid
closest_point = ClosestPoint(Point=area.Centroid, Cloud=evaluate_surface.Point)  # -> ClosestPoint, CPIndex, Distance
weaverbird_s_picture_frame_2 = WeaverbirdsPictureFrame(MeshPolylines=simple_mesh_2, Distance=number_slider_11, InsetType=0)  # disabled
bounds = Bounds(Numbers=closest_point.Distance)
construct_domain = ConstructDomain(DomainStart=Slider(2, range=0..10), DomainEnd=Slider(34, range=0..100))
mesh_2 = Mesh(flatten(weaverbird_s_picture_frame_2))  # disabled
remap_numbers = RemapNumbers(Value=closest_point.Distance, Source=bounds, Target=construct_domain)  # -> Mapped, Clipped
number_slider_12 = Slider(3, range=0..10)  # disabled
weaverbird_s_join_meshes_and_weld_2 = WeaverbirdsJoinMeshesAndWeld(Mesh=mesh_2, Weld=True)  # disabled
weaverbird_s_catmull_clark_subdivision_3 = WeaverbirdsCatmullClarkSubdivision(MeshCurves=weaverbird_s_join_meshes_and_weld_2, Level=number_slider_12, SmoothNakedEdges=1)  # disabled
weaverbird_s_mesh_window_2 = WeaverbirdsMeshWindow(MeshPolylines=simple_mesh_2, Distance=number_slider_11, InsetType=0)  # disabled
number_slider_13 = Slider(2, range=0..10)  # disabled
weaverbird_s_catmull_clark_subdivision_4 = WeaverbirdsCatmullClarkSubdivision(MeshCurves=weaverbird_s_mesh_window_2, Level=number_slider_12, SmoothNakedEdges=1)  # disabled
number_slider_14 = Slider(2, range=0..10)  # disabled
simple_mesh_3 = SimpleMesh(Brep=isotrim_6)
weaverbird_s_picture_frame_3 = WeaverbirdsPictureFrame(MeshPolylines=graft(simple_mesh_3), Distance=graft(remap_numbers.Mapped), InsetType=0)
weaverbird_s_mesh_thicken_3 = WeaverbirdsMeshThicken(MeshCurves=weaverbird_s_catmull_clark_subdivision_4, Distance=expr("-X", number_slider_14), OffsetType=0)  # disabled
weaverbird_s_mesh_thicken_4 = WeaverbirdsMeshThicken(MeshCurves=weaverbird_s_catmull_clark_subdivision_3, Distance=number_slider_13, OffsetType=0)  # disabled
colour_swatch = ColourSwatch(SwatchColor=RGB(111, 218, 255))  # disabled
colour_swatch_2 = ColourSwatch(SwatchColor=RGB(0, 0, 71))  # disabled
mesh_3 = Mesh(flatten(weaverbird_s_picture_frame_3))
number_slider_15 = Slider(3, range=0..10)
custom_preview_3 = CustomPreview(Geometry=weaverbird_s_mesh_thicken_3, Material=colour_swatch)  # disabled
weaverbird_s_join_meshes_and_weld_3 = WeaverbirdsJoinMeshesAndWeld(Mesh=mesh_3, Weld=True)
custom_preview_4 = CustomPreview(Geometry=weaverbird_s_mesh_thicken_4, Material=colour_swatch_2)  # disabled
weaverbird_s_catmull_clark_subdivision_5 = WeaverbirdsCatmullClarkSubdivision(MeshCurves=weaverbird_s_join_meshes_and_weld_3, Level=number_slider_15, SmoothNakedEdges=1)
box_2 = Box(weaverbird_s_mesh_thicken_4)  # disabled
weaverbird_s_mesh_window_3 = WeaverbirdsMeshWindow(MeshPolylines=graft(simple_mesh_3), Distance=graft(remap_numbers.Mapped), InsetType=0)
deconstruct_brep_2 = DeconstructBrep(Brep=box_2)  # -> Faces, Edges, Vertices; disabled
number_slider_16 = Slider(0, range=0..6)  # disabled
weaverbird_s_catmull_clark_subdivision_6 = WeaverbirdsCatmullClarkSubdivision(MeshCurves=weaverbird_s_mesh_window_3, Level=number_slider_15, SmoothNakedEdges=1)
list_item_2 = ListItem(List=deconstruct_brep_2.Edges, Index=number_slider_16, Wrap=True)  # disabled
number_slider_17 = Slider(10, range=0..10)  # disabled
number_slider_18 = Slider(4.5, range=0..10)  # disabled
end_points_2 = EndPoints(Curve=list_item_2)  # -> Start, End; disabled
aligned_dimension_2 = AlignedDimension(
    Plane=PlaneXY(0, 0, 0),
    PointA=end_points_2.Start,
    PointB=end_points_2.End,
    Offset=expr("-X", number_slider_17),
    Text="{0:0.00}",
    Size=number_slider_18)  # disabled
weaverbird_s_mesh_thicken_5 = WeaverbirdsMeshThicken(MeshCurves=weaverbird_s_catmull_clark_subdivision_6, Distance=expr("-X", Slider(2, range=0..10)), OffsetType=0)
weaverbird_s_mesh_thicken_6 = WeaverbirdsMeshThicken(MeshCurves=weaverbird_s_catmull_clark_subdivision_5, Distance=Slider(2, range=0..10), OffsetType=0)
custom_preview_5 = CustomPreview(Geometry=weaverbird_s_mesh_thicken_5, Material=ColourSwatch(SwatchColor=RGB(111, 218, 255)))
custom_preview_6 = CustomPreview(Geometry=weaverbird_s_mesh_thicken_6, Material=ColourSwatch(SwatchColor=RGB(0, 0, 71)))
box_3 = Box(weaverbird_s_mesh_thicken_6)
deconstruct_brep_3 = DeconstructBrep(Brep=box_3)  # -> Faces, Edges, Vertices
list_item_3 = ListItem(List=deconstruct_brep_3.Edges, Index=Slider(0, range=0..6), Wrap=True)
end_points_3 = EndPoints(Curve=list_item_3)  # -> Start, End
aligned_dimension_3 = AlignedDimension(
    Plane=PlaneXY(0, 0, 0),
    PointA=end_points_3.Start,
    PointB=end_points_3.End,
    Offset=expr("-X", Slider(10, range=0..10)),
    Text="{0:0.00}",
    Size=Slider(4.5, range=0..10))
